# Dynamo graph ProrubimCommonKit.dyn (Dynamo 0.9.0.3067)

code_block = CodeBlock { {"А","Б","В","Г","Д","Е","Ж","И"}; {1..20}; }
renumber = Prorubim.GridsRenumbering.Grids.Renumber(arg1=code_block.out0)
categories = Categories("Grids")
all_elements_of_category = ElementsOfCategory(categories)
divideByOrientation = Prorubim.GridsRenumbering.Grids.DivideByOrientation(all_elements_of_category)
code_block_2 = CodeBlock { "/1"; }
code_block_3 = CodeBlock { "индекс"; }
renumber_2 = Prorubim.GridsRenumbering.Grids.Renumber(divideByOrientation.out1, code_block.out1, arg3=code_block_2, arg5=code_block_3)
